# Grasshopper definition ExampleDefinition.gh (Grasshopper 0.9.76)
# plug-ins: Grevit.GrassHopper

# ----
# Profile based Wall
panel = Panel("Level 1")
line = Line([Line((0, 24, 0), (0, 24, 11)), Line((0, 24, 11), (0, 37, 11)), Line((0, 37, 11), (0, 45, 5)), Line((0, 45, 5), (0, 45, 0)), Line((0, 45, 0), (0, 24, 0))])
# Model Elements
revit_pbwall = GrevitRevitProfileBasedWall(Profile=line, Type="Generic Wall", Level=panel)

# ----
# Floor
pt = ConstructPoint(XCoordinate=-2, YCoordinate=-2, ZCoordinate=0)
pt_2 = ConstructPoint(XCoordinate=80, YCoordinate=20, ZCoordinate=0)
rec_2pt = Rectangle2Pt(Plane=PlaneXY(0, 0, 0), PointA=pt, PointB=pt_2, Radius=0)  # -> Rectangle, Length
boundary = BoundarySurfaces(Edges=rec_2pt.Rectangle)
grevit_revit_slab = GrevitRevitSlab(Surface=boundary, Type="Concrete 8\\\"", Levelbottom="Level 1")

# ----
# Topography
pop3d = Populate3D(Region={Plane=PlaneXY(0, 0, 0), X=Domain(0, 10), Y=Domain(0, 10), Z=Domain(0, 2)}, Count=10, Seed=1)
revit_topography = GrevitRevitTopography(Points=pop3d)

# ----
# Extrusion
number_slider = Slider(4, range=0..10)
rec_2pt_2 = Rectangle2Pt(Plane=PlaneXY(0, 0, 0), PointA=Point(7, -7, 0), PointB=Point(23, -19, 0), Radius=0)  # -> Rectangle, Length
debrep = DeconstructBrep(Brep=rec_2pt_2.Rectangle)  # -> Faces, Edges, Vertices
Z = UnitZ(Factor=number_slider)
join = JoinCurves(Curves=debrep.Edges, Preserve=False)
revit_extrusion = GrevitRevitExtrusion(Outline=join, Vector=Z)

# ----
# Adaptive Component
panel_2 = Panel("Family1")
pt_3 = Point([Point(25, -25, 0), Point(28, -23, 0), Point(28, -27, 0)])
revit_adaptive = GrevitRevitAdaptiveComponent(Points=pt_3, Family="Family1", Type=panel_2)

# ----
# Beam
revit_structbeam = GrevitRevitStructuralBeam()
pt_4 = Point([Point(52, -17, 0), Point(57, -21, 0)])
revit_family = GrevitRevitFamilyInstance(Points=pt_4, Level="Level 1", Family="Beam", Type="500 x 500", StructuralType=revit_structbeam)

line_2 = Line([Line((-19, 0, 1), (-6, 0, 1)), Line((-19, 0, 7), (-6, 0, 7))])

# ----
# Column
pt_5 = ConstructPoint(XCoordinate=0, YCoordinate=0, ZCoordinate=0)
arrrec = RectangularArray(Geometry=pt_5, Cell={Plane=PlaneXY(0, 0, 0), Size=Domain2(u=0..10, v=0..5)}, XCount=6, YCount=3)  # -> Geometry, Transform
Z_2 = UnitZ(Factor=Slider(9, range=0..10))
move = Move(Geometry=arrrec.Geometry, Motion=Z_2)  # -> Geometry, Transform
revit_column = GrevitRevitColumn(Family="Column", Type="500 x 500", Level="Level 1", PointTop=arrrec.Geometry, PointBottom=move.Geometry)

send = GrevitSend(Components=revit_pbwall, Send=Button())
send_2 = GrevitSend(Components=revit_adaptive, Send=Button())
send_3 = GrevitSend(Components=flatten(revit_topography), Send=Button())
send_4 = GrevitSend(Components=revit_extrusion, Send=Button())
send_5 = GrevitSend(Components=flatten(revit_family), Send=Button())
send_6 = GrevitSend(Components=flatten(revit_column), Send=Button())
send_7 = GrevitSend(Components=flatten(grevit_revit_slab), Send=Button())

# ----
# Text
panel_3 = Panel("Hello World")
pt_6 = ConstructPoint(XCoordinate=0, YCoordinate=0, ZCoordinate=0)
revit_text = GrevitRevitTextNote(Text=panel_3, Location=pt_6, View="Level 1")

# ----
# Room
panel_4 = Panel("Room")
revit_room = GrevitRevitRoom(Name=panel_4, Number="A", Phase="Existing")

# ----
# Annotation Elements
# Gridline
line_3 = Line([Line((4, -6, 0), (29, -6, 0)), Line((5, -10, 0), (30, -10, 0)), Line((6, -15, 0), (39, -15, 0))])
revit_grid = GrevitRevitGrid(Gridline=line_3)

# ----
# Lines
pt_7 = ConstructPoint(XCoordinate=-2, YCoordinate=-2, ZCoordinate=0)
pt_8 = ConstructPoint(XCoordinate=80, YCoordinate=20, ZCoordinate=0)
ln = Line(StartPoint=pt_7, EndPoint=pt_8)
revit_curve = GrevitRevitCurve(Curve=ln, IsModelLine=Toggle(True))

# ----
# Filter
filter_rule_comparer = FilterRuleComparer({"Equals", "NotEquals", "Greater", "Less", "GreaterOrEqual", "LessOrEqual", "Contains", "NotContains", "EndsWith", "NotEndsWith", "BeginsWith", "NotBeginsWith"}, selected="Equals")
revit_filter_rule = GrevitRevitFilterRule(Name="Mark", Operator=filter_rule_comparer, Value="123")
swatch = ColourSwatch(SwatchColor=RGB(0, 0, 0))
revit_filter = GrevitRevitFilter(Name="MyRule", View="Level 1", Rules=revit_filter_rule, Categories="Walls", CutFillColor=swatch, CutLineColor=swatch)

# ----
# Level
number_slider_2 = Slider(400, range=0..1000)
revit_level = GrevitRevitLevel(Name="MyLevel", Elevation=number_slider_2, CreateView=Toggle(False))

# ----
# Hatch
panel_5 = Panel("Level 1")
pt_9 = Point(Point(0, -2, -1))
revit_hatch = GrevitRevitHatch(Points=pt_9, View=panel_5)

# ----
# Ref Plane
panel_6 = Panel("MyRefPlane")
planesrf = PlaneSurface(Plane=PlaneXY(0, 0, 0), XSize=Domain(-10, 10), YSize=Domain(-10, 10))
revit_refplane = GrevitRevitReferencePlane(Name=panel_6, Plane=planesrf)

send_8 = GrevitSend(Components=revit_grid, Send=Button())
send_9 = GrevitSend(Components=revit_hatch, Send=Button())
send_10 = GrevitSend(Components=revit_level, Send=Button())
send_11 = GrevitSend(Components=revit_room, Send=Button())
send_12 = GrevitSend(Components=flatten(revit_text), Send=Button())
send_13 = GrevitSend(Components=revit_refplane, Send=Button())
send_14 = GrevitSend(Components=flatten(revit_curve), Send=Button())
line_4 = Line([Line((-20, -9, 0), (-19, -33, 0)), Line((-13, -13, 0), (-1, -34, 0))])
send_15 = GrevitSend(Components=revit_filter, Send=Button())

# ----
# Wall by Face
panel_7 = Panel("Copy Stable Face Reference from Grevit's Face Reference Tool in Revit")
grevit_revit_facewall = GrevitRevitFaceWall(StableReference=panel_7)

grevit_revit_wall = GrevitRevitWall(Baseline=line_4, Height=Slider(30, range=0..100))

# ----
# Shaft
panel_8 = Panel("Level 5")
rectangle_2pt = Rectangle2Pt(Plane=PlaneXY(0, 0, 0), PointA=Point(0, 0, 0), PointB=Point(10, 5, 0), Radius=0)  # -> Rectangle, Length
grevit_revit_shaft = GrevitRevitShaft(Surface=rectangle_2pt.Rectangle, Leveltop=panel_8, Levelbottom="Level 1")

# ----
# New Elements
# Filter
panel_9 = Panel("MyFilter")
grevit_id = GrevitID(GrevitComponent=grevit_revit_wall)
grevit_revit_selectionset = GrevitRevitSelectionSet(Name=panel_9, IDs=grevit_id)

grevit_send = GrevitSend(Components=flatten(grevit_revit_shaft), Send=Button())
grevit_send_2 = GrevitSend(Components=flatten(grevit_revit_facewall), Send=Button())
grevit_send_3 = GrevitSend(Components=flatten([grevit_revit_selectionset, grevit_id]), Send=Button())

# ----
# Wall and Parameter
panel_10 = Panel("Mark")
revit_parameter = GrevitRevitParameter(Name=panel_10, Value="123")
arc = CircularArc({Angle=0, Angle=2.030311728, Plane=Plane(origin=(28, -26, 0), x=(0.7399400734, 0.672672794, 0), y=(0.672672794, -0.7399400734, 0)), Radius=14.86606875})

multiplication = Multiplication(A=Slider(3, range=0..10), B=3.28)

revit_wall = GrevitRevitWall(Baseline=[arc, line_2], Type="Generic Wall", Levelbottom="Level 1", Height=multiplication, Parameters=revit_parameter)

send_16 = GrevitSend(Components=revit_wall, Send=Button())
